# Grasshopper definition foladablecase.gh (Grasshopper 1.0.5)
# plug-ins: LunchBox

triangle_offset = Slider(0.3, range=0..1)
whole_length = Slider(90, range=0..100)
pick_extrude = Slider(2, range=0..10)
box_extrude = Slider(8, range=0..10)
panel = Panel("Bake button")
button = Button()

middle_length = Slider(12, range=0..20)
number_slider = Slider(0.4, range=0..1)
number_slider_2 = Slider(2, range=0..10)
number_slider_3 = Slider(90, range=0..100)
number_slider_4 = Slider(10, range=0..10)
number_slider_5 = Slider(5, range=0..10)
panel_2 = Panel("Default")
rectangle = Rectangle(Plane=PlaneXY(0, 0, 0), XSize=whole_length, YSize=whole_length, Radius=0)  # -> Rectangle, Length
number_slider_6 = Slider(0, range=0..100)
rectangle_2 = Rectangle(Plane=PlaneXY(0, 0, 0), XSize=whole_length, YSize=middle_length, Radius=0)  # -> Rectangle, Length
subtraction = Subtraction(A=Slider(0, range=0..100), B=Slider(2, range=0..10))
offset = OffsetCurve(Curve=rectangle.Rectangle, Distance=subtraction, Plane=PlaneXY(0, 0, 0), Corners=1)
pop2d = Populate2D(Region=offset, Count=Slider(9, range=0..10), Seed=1)
addition = Addition(A=whole_length, B=middle_length)
del = DelaunayMesh(Points=pop2d, Plane=PlaneXY(0, 0, 0))
hull = ConvexHull(Points=pop2d, Plane=PlaneXY(0, 0, 0))  # -> Hull, HullZ, Indices
vec = VectorXYZ(XComponent=number_slider_6, YComponent=whole_length, ZComponent=number_slider_6)  # -> Vector, Length
vec_2 = VectorXYZ(XComponent=number_slider_6, YComponent=number_slider_6, ZComponent=box_extrude)  # -> Vector, Length
vec_3 = VectorXYZ(XComponent=number_slider_6, YComponent=addition, ZComponent=number_slider_6)  # -> Vector, Length
number_slider_7 = Slider(0, range=0..100)
move = Move(Geometry=rectangle_2.Rectangle, Motion=vec.Vector)  # -> Geometry, Transform
number_slider_8 = Slider(0, range=0..100)
faceb = FaceBoundaries(Mesh=del)
rectangle_3 = Rectangle(Plane=PlaneXY(0, 0, 0), XSize=whole_length, YSize=whole_length, Radius=0)  # -> Rectangle, Length
subtraction_2 = Subtraction(A=Slider(0, range=0..100), B=triangle_offset)
fillet = Fillet(Curve=faceb, Radius=Slider(1.5, range=0..10))
boundary = BoundarySurfaces(Edges=move.Geometry)
subtraction_3 = Subtraction(A=Slider(0, range=0..100), B=Slider(1, range=0..1))
vec_4 = VectorXYZ(XComponent=number_slider_8, YComponent=number_slider_8, ZComponent=Slider(0.2, range=0..1))  # -> Vector, Length
move_2 = Move(Geometry=rectangle_3.Rectangle, Motion=vec_3.Vector)  # -> Geometry, Transform
offset_2 = Offset(Curve=fillet, Distance=subtraction_2, Plane=PlaneXY(0, 0, 0), Corners=1)
vec_5 = VectorXYZ(XComponent=number_slider_7, YComponent=number_slider_7, ZComponent=Slider(1, range=0..1))  # -> Vector, Length
number_slider_9 = Slider(0, range=0..10)
offset_3 = Offset(Curve=move_2.Geometry, Distance=subtraction_3, Plane=PlaneXY(0, 0, 0), Corners=1)
boundary_2 = BoundarySurfaces(Edges=move_2.Geometry)
move_3 = Move(Geometry=offset_3, Motion=vec_5.Vector)  # -> Geometry, Transform
boundary_3 = BoundarySurfaces(Edges=offset_2)
extr = Extrude(Base=boundary_2, Direction=vec_2.Vector)
vec_6 = VectorXYZ(XComponent=number_slider_9, YComponent=number_slider_9, ZComponent=pick_extrude)  # -> Vector, Length
extr_2 = Extrude(Base=move_3.Geometry, Direction=[vec_6.Vector, vec_2.Vector])
cap = CapHoles(Brep=extr)
extr_3 = Extrude(Base=hull.Hull, Direction=vec_6.Vector)
cap_2 = CapHoles(Brep=extr_2)
extr_4 = Extrude(Base=rectangle.Rectangle, Direction=vec_6.Vector)
cap_3 = CapHoles(Brep=extr_4)
cap_4 = CapHoles(Brep=extr_3)

sdiff = SolidDifference(BrepsA=cap, BrepsB=cap_2)
sdiff_2 = SolidDifference(BrepsA=cap_3, BrepsB=cap_4)
extr_5 = Extrude(Base=boundary_3, Direction=vec_6.Vector)
extr_6 = Extrude(Base=boundary, Direction=vec_4.Vector)

debrep = DeconstructBrep(Brep=extr_5)  # -> Faces, Edges, Vertices
curvepoint = PointOnCurve(debrep.Edges, parameter=0.5)
points = PointList(Points=curvepoint, Size=Slider(8.26, range=0..10))

bake = ObjectBake(
    BakeToggle=button,
    GeometryObjects=[sdiff, sdiff_2, extr_5],
    Layer="main_parts",
    ObjectName="GH_Obj",
    ObjectColor=RGB(255, 255, 255),
    LayerColor=RGB(255, 255, 255))
bake_2 = ObjectBake(
    BakeToggle=button,
    GeometryObjects=extr_6,
    Layer="sub_part",
    ObjectName="GH_Obj",
    ObjectColor=RGB(255, 255, 255),
    LayerColor=RGB(255, 255, 255))
