# Grasshopper definition makebutton.gh (Grasshopper 1.0.5)

brep = Brep(<brep referenced from the Rhino model>)
brep_2 = Brep(<brep referenced from the Rhino model>)
隙間の倍率 = Slider(0.99, range=0..1)
ボタンの寸法 = Slider(2, range=0..20)
ボタンの穴 = Slider(1, range=0..10)
_４つ穴の判定体積 = Slider(200, range=0..1000)
_2つ穴の判定体積 = Slider(100, range=0..100)
popgeo = PopulateGeometry(Geometry=brep, Count=Slider(800, range=0..1000), Seed=1)
voronoi³ = Voronoi3D(Points=popgeo)  # -> Cells, Boundary
sint = SolidIntersection(BrepsA=voronoi³.Cells, BrepsB=brep_2)
vmoments = VolumeMoments(Geometry=sint)  # -> graft(Volume), graft(Centroid), graft(Inertia), InertiaError, Secondary, SecondaryError, Gyration
panel = Panel(vmoments.Volume)
flatten = FlattenTree(Tree=vmoments.Centroid, Path="{0}")
larger = LargerThan(FirstNumber=panel, SecondNumber=_４つ穴の判定体積)  # -> LargerThan, OrEqualTo
dispatch = Dispatch(List=panel, DispatchPattern=larger.LargerThan)  # -> ListA, ListB
panel_2 = Panel(dispatch.ListB)
panel_3 = Panel(vmoments.Inertia)
panel_4 = Panel(vmoments.Centroid)
larger_2 = LargerThan(FirstNumber=panel_2, SecondNumber=_2つ穴の判定体積)  # -> LargerThan, OrEqualTo
panel_5 = Panel(dispatch.ListA)
dispatch_2 = Dispatch(List=dispatch.ListB, DispatchPattern=larger_2.LargerThan)  # -> ListA, ListB
dispatch_3 = Dispatch(List=panel_4, DispatchPattern=panel_5)  # -> ListA, ListB
dispatch_4 = Dispatch(List=panel_3, DispatchPattern=panel_5)  # -> ListA, ListB
panel_6 = Panel(dispatch_3.ListA)
panel_7 = Panel(dispatch_4.ListA)

panel_8 = Panel(dispatch_2.ListA)
panel_9 = Panel(vmoments.Inertia)
panel_10 = Panel(vmoments.Centroid)
dispatch_5 = Dispatch(List=panel_10, DispatchPattern=panel_8)  # -> ListA, ListB
dispatch_6 = Dispatch(List=panel_9, DispatchPattern=panel_8)  # -> ListA, ListB
panel_11 = Panel(dispatch_5.ListA)
panel_12 = Panel(dispatch_6.ListA)
flatten_2 = FlattenTree(Tree=panel_11, Path="{0}")
flatten_3 = FlattenTree(Tree=panel_12, Path="{0}")
pl = PlaneNormal(Origin=flatten_2, ZAxis=flatten_3)  # -> graft(Plane)
cir = Circle(Plane=pl, Radius=ボタンの寸法)
divide = DivideCurve(Curve=cir, Count=Slider(2, range=0..10), Kinks=False)  # -> Points, Tangents, Parameters
number_slider = Slider(6, range=0..10)
subtraction = Subtraction(A=Slider(0, range=0..100), B=number_slider)
dup = DuplicateData(Data=pl, Number=Slider(4, range=0..10), Order=False)
circle = CircleCNR(Center=divide.Points, Normal=dup, Radius=ボタンの穴)

flatten_4 = FlattenTree(Tree=panel_6, Path="{0}")
flatten_5 = FlattenTree(Tree=panel_7, Path="{0}")
number_slider_2 = Slider(4, range=0..10)
pl_2 = PlaneNormal(Origin=flatten_4, ZAxis=flatten_5)  # -> graft(Plane)
cir_2 = Circle(Plane=pl_2, Radius=ボタンの寸法)
panel_13 = Panel(pl_2)
divide_2 = DivideCurve(Curve=cir_2, Count=Slider(4, range=0..10), Kinks=False)  # -> Points, Tangents, Parameters
subtraction_2 = Subtraction(A=Slider(0, range=0..100), B=number_slider_2)
dup_2 = DuplicateData(Data=pl_2, Number=Slider(4, range=0..10), Order=False)
panel_14 = Panel(dup_2)
panel_15 = Panel(divide_2.Points)
circle_2 = CircleCNR(Center=divide_2.Points, Normal=dup_2, Radius=ボタンの穴)

cyl = Cylinder(Base=circle_2, Radius=ボタンの穴, Length=subtraction_2)
cyl_2 = Cylinder(Base=circle_2, Radius=ボタンの穴, Length=number_slider_2)
cap = CapHoles(Brep=cyl_2)
cap_2 = CapHoles(Brep=cyl)

panel_16 = Panel(cir_2)
scale = Scale(Geometry=sint, Center=flatten, Factor=隙間の倍率)  # -> Geometry, Transform

cyl_3 = Cylinder(Base=circle, Radius=ボタンの穴, Length=subtraction)
cyl_4 = Cylinder(Base=circle, Radius=ボタンの穴, Length=number_slider)
cap_3 = CapHoles(Brep=cyl_4)
cap_4 = CapHoles(Brep=cyl_3)
